# Grasshopper definition TestConnection.gh (Grasshopper 1.0.7)
# Copyright: 2021
# Copyright: 2022-28-21
# plug-ins: GrasshopperRadianceLinuxConnector, LadybugGrasshopper, Human, HDTTreeUtils

# ----
# Connect
panel = Panel("mss")
connect_ssh = ConnectSSH(User=panel, Ip="127.0.0.1", Password="_prompt", _port=22, Connect=Toggle(True))  # -> Status, Run
panel_2 = Panel(connect_ssh.Status)

# ----
# Setup globals
panel_3 = Panel("""~/simulation/test_project
7""")
panel_4 = Panel("""proj
cpus""")
globals = SetupGlobals(Keys=panel_4, Values=panel_3)
panel_5 = Panel(globals)

# ----
# Test connection
testconnection = TestConnection()  # -> Status, Errors
panel_6 = Panel(testconnection.Status)
panel_7 = Panel(testconnection.Errors)

panel_8 = Panel("""export PATH=$PATH.:/usr/local/radiance/bin
export RAYPATH=.:/usr/local/radiance/lib
objview <glowmat> ~/simulation/<name>.rad | meta2tga -x 1048 -y 1048 | ra_t8 -r > ~/simulation/<name>.hdr
normtiff ~/simulation/<name>.hdr ~/simulation/<name>.tif
convert ~/simulation/<name>.tif ~/simulation/<name>.png
echo "C:\Users\mm1013\simulation\<name>.png"
""")

panel_9 = Panel("""Mesh
Polysurface
Surface
Extrusion""")
dpipeline = DynamicGeometryPipeline(
    LayerFilter="Daylight_Inputs::*",
    TypeFilter=panel_9,
    NameFilter="*",
    GroupByLayer=False,
    GroupByType=False,
    IncludeHidden=True,
    IncludeLocked=True,
    enableFullPath=True,
    listenToAttributes=True)
dam = DataDam(DataA=dpipeline, BufferDelay=10000000, BufferMode=0)
objatts = ObjectAttributes(ObjectOrAttributes=dam)  # -> Name, LayerName, LayerFullPath, Color, MaterialName, LinetypeName, GroupIndices, PlotWeight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
cset = CreateSet(List=objatts.LayerName)  # -> Set, Map
assign_paths = AssignPaths(InputData=flatten(dam), PathsToAssign=flatten(cset.Map))
python = GhPythonScript(layer_name=graft(cset.Set))  # -> is_opaque, is_transparent, is_grid, is_HB_Room, is_HB_Window
# ---------- python: Python ----------
__author__ = "mm1013"
__version__ = "2022.01.16"

import rhinoscriptsyntax as rs

is_grid = layer_name == "Grids"

if layer_name.startswith("HB_"):
    is_opaque = is_transparent = is_grid = False
    
    is_HB_Window = layer_name.endswith("%")
    is_HB_Room = layer_name == "HB_Rooms"
    
    
else:
    if is_grid:
        is_opaque = False
        is_transparent = False
    else:
        is_transparent = layer_name.endswith("%")
        if is_transparent:
            transmittance = layer_name.split("_")[-1].replace("%","")
        is_opaque = not is_transparent
# ---------- end python ----------
layer_name = Text(cset.Set)
geo = Geometry(assign_paths)

vertical_offset = Panel("0.75m")
grid_size = Panel("0.5m")
docunits = ConvertToDocumentUnits(ValueString=vertical_offset)
docunits_2 = ConvertToDocumentUnits(ValueString=grid_size)

panel_10 = Panel("""echo $PATH
genbox""")  # disabled
falsestart = LBFalseStartToggle(False)  # disabled
execute_ssh_async = ExecuteSSHAsync(SSHCommands=panel_10, Run=falsestart)  # -> Stdout, Stderr, Log, Pid, Ran; disabled
panel_11 = Panel(execute_ssh_async.Stderr)  # disabled
panel_12 = Panel(execute_ssh_async.Stdout)  # disabled

mesh = Mesh([<mesh referenced from the Rhino model> x2])
facen = FaceNormals(Mesh=mesh)  # -> Centers, Normals
demesh = DeconstructMesh(Mesh=mesh)  # -> Vertices, Faces, Colours, Normals
panel_13 = Panel("""up_clock3
up_ccw3""")
panel_14 = Panel("""glowmat
glowmat""")
points = PointList(Points=demesh.Vertices, Size="50")
vdis = VectorDisplay(Anchor=facen.Centers, Vector=expr("x*500", facen.Normals))
panel_15 = Panel("""echo "void glow glowmat
0
0
4 12 12 12 1000" > <target>;echo <target>""")
falsestart_2 = LBFalseStartToggle(False)
mesh2obj = MeshToObj(Mesh=graft(mesh), Name=graft(panel_13), ModifierName=graft(panel_14), Run=falsestart_2)  # -> ObjFiles, MapFile, Run
overrides = ApplyOverrides(Input=panel_15, AdditionalKeys="target", AdditionalValues="~/simulation/testglow.rad")  # -> Output, Pairs
execute_ssh_async_2 = ExecuteSSHAsync(SSHCommands=overrides.Output, Run=falsestart_2)  # -> Stdout, Stderr, Log, Pid, Ran
overrides_2 = ApplyOverrides(Input=panel_8, AdditionalKeys="glowmat", AdditionalValues=execute_ssh_async_2.Stdout)  # -> Output, Pairs
overrides_3 = ApplyOverrides(Input=overrides_2.Output, AdditionalKeys="name", AdditionalValues=graft(panel_13))  # -> Output, Pairs
panel_16 = Panel("echo hi")
panel_17 = Panel(overrides_3.Output)

# ----
# 5 phase bash script from andy mcneil
panel_18 = Panel("""#!/bin/bash

procs=4

### First let me download and unpacking Axel\'s files for rtcontrib lesson

printf "\nDownloading Axels rtcontrib lesson files...\n"
curl -O http://www.jaloxa.eu/resources/radiance/documentation/docs/rtcontrib_lesson.tgz
tar -xf rtcontrib_lesson.tgz
mv rtcontrib_lesson 5p_tutorial_examples

cd 5p_tutorial_examples

mkdir bsdf hourlypics hourlypics_dir hourlypics_ds hourlyresult \
	matrices octs viewpics viewpics_dir viewpics_ds
	
### Let me download the weather data file for you
printf "\nDownloading weather data...\n"
curl -O http://apps1.eere.energy.gov/buildings/energyplus/weatherdata/4_north_and_central_america_wmo_region_4/1_usa/USA_CA_Oakland.Intl.AP.724930_TMY3.zip
tar -xf USA_CA_Oakland.Intl.AP.724930_TMY3.zip
rm USA_CA_Oakland.Intl.AP.724930_TMY3.ddy 
rm USA_CA_Oakland.Intl.AP.724930_TMY3.stat
rm USA_CA_Oakland.Intl.AP.724930_TMY3.zip 
mv USA_CA_Oakland.Intl.AP.724930_TMY3.epw skies/.

# grabbing reinsrc.cal from CVS
printf "\nDownloading reinsrc.cal...\n"
curl -O http://radiance-online.org/cgi-bin/viewcvs.cgi/ray/src/cal/cal/reinsrc.cal

### Section 6.1 - Model adjustments for five-phase simulation
printf "\nMaking model adjustments...\n"
cat <<EOF > objects/testroom_Swall.rad
!genbox wall_mat wall_s_bottom 4 .3 1 |xform -t 0 -.3 0
!genbox wall_mat wall_s_top 4 .3 .5 |xform -t 0 -.3 2
!genbox wall_mat wall_s_west .5 .3 1 |xform -t 0 -.3 1
!genbox wall_mat wall_s_west .5 .3 1 |xform -t 3.5 -.3 1
EOF

cat <<EOF > objects/testroom.rad
!genbox floor_mat floor 4.6 6.6 .3 |xform -t -.3 -.3 -.3
!genbox ceiling_mat ceiling 4.6 6.6 .3 |xform -t -.3 -.3 2.5

!genbox wall_mat wall_w .3 6.6 2.5 |xform -t -.3 -.3 0
!genbox wall_mat wall_e .3 6.6 2.5 |xform -t 4 -.3 0
!genbox wall_mat wall_n 4 .3 2.5 |xform -t 0 6 0
EOF

cat <<EOF > objects/glazing.rad
void glass glazing
0
0
3 0.73 0.73 0.73

glazing polygon glass
0
0
12    0.5  -0.25   1
        0.5  -0.25   2
        3.5  -0.25   2
        3.5  -0.25   1
EOF

cat <<EOF > objects/venetianblind.rad
void plastic blindslat
0
0
5 .65 .65 .65 .01 0 

!genblinds blindslat blinds .05 3 1 25 0 +r .15 | xform -rz -90 -t 0.5 -.15 1 
EOF

cat <<EOF > objects/viewmtxsurf.rad
void glow viewsurf
0
0
4 1 1 1 0

viewsurf polygon inside
0
0
12    0.5   0   1
        0.5   0   2
        3.5   0   2
        3.5   0   1
EOF

cat <<EOF > objects/daymtxsurf.rad
void plastic daymtxsurf
0
0
5 0 0 0 0 0

daymtxsurf polygon outside
0
0
12    0.5   -0.3   1
        0.5   -0.3   2
        3.5   -0.3   2
        3.5   -0.3  1
EOF

cat <<EOF > objects/glazing_bsdf.rad
void BSDF BSDFproxy
6 0.30 bsdf/fullwindow_t45.xml 0 0 1 .
0
0

BSDFproxy polygon inside
0
0
12    0.5   0   1
        0.5   0   2
        3.5   0   2
        3.5   0   1
EOF

cat <<EOF >> materials/testroom.mat
void plastic black
0
0
5 0 0 0 0 0
EOF


### Section 6.2 - Creating BSDFs
xform -rz 180 -rx -90 -t 4 0 0 objects/glazing.rad objects/venetianblind.rad materials/testroom.mat \
	objects/testroom_Swall.rad > bsdf/fullwindow.rad

### I am going to save you the trouble of generating the High-Res BSDF
#genBSDF -n $procs +f +b -geom meter -dim 0.5 3.5 1 2 -.3 0 -t4 5 \
#	bsdf/fullwindow.rad > bsdf/fullwindow_t45.xml
printf "\nDownloading tensor tree BSDF...\n"
curl -o bsdf/fullwindow_t45.xml http://www.radiance-online.org/learning/tutorials/fivephasetutorialfiles/fullwindow_t45.xml

### I will also save you the trouble with the low-res BSDF
#bsdf2klems bsdf/fullwindow_t45.xml > bsdf/fullwindow_klems.xml
#genBSDF -n $procs +f +b -geom meter -dim 0.5 3.5 1 2 -.3 0 \
#	bsdf/fullwindow.rad > bsdf/fullwindow_klems.xml
printf "\nDownloading klems BSDF...\n"
curl -o bsdf/fullwindow.xml http://www.radiance-online.org/learning/tutorials/fivephasetutorialfiles/fullwindow.xml


### Section 6.3 - View matrix (V)
printf "\nDoing 5-phase simulation for sensor points...\n"
oconv materials/testroom.mat objects/daymtxsurf.rad objects/ground.rad objects/testroom.rad \
	objects/testroom_Swall.rad objects/viewmtxsurf.rad skies/sky_white.rad \
	objects/viewmtxsurf.rad objects/daymtxsurf.rad > octs/model_3ph.oct
printf "\nView Matrix\n"
time rcontrib < data/photocells.pts -n $procs -f klems_int.cal -b kbinS -bn Nkbins -m viewsurf \
	-I+ -ab 10 -ad 65536 -lw 1.52e-5 octs/model_3ph.oct > matrices/viewmatrix.vmx


### Section 6.4 - Direct view matrix (Vd)
printf "\nDirect View Matrix\n"
time rcontrib < data/photocells.pts -n $procs -f klems_int.cal -b kbinS -bn Nkbins -m viewsurf \
	-I+ -ab 1 -ad 65536 -lw 1.52e-5 octs/model_3ph.oct > matrices/viewmatrix_direct.vmx

### Section 6.5 - Daylight matrix (D)
printf "\nDaylight Matrix\n"
time genklemsamp -c 1000 -vd 0 -1 0 objects/daymtxsurf.rad | \
	rcontrib -n $procs -c 1000 -ab 2 -ad 1024 -e MF:1 -f reinhart.cal -b rbin -bn Nrbins \
		-m sky_glow octs/model_3ph.oct > matrices/daylightmatrix.dmx

### Section 6.6 - Direct daylight matrix (Dd)
printf "\nDirect Daylight Matrix\n"
xform -m black objects/testroom_Swall.rad objects/testroom.rad objects/ground.rad \
	objects/venetianblind.rad | oconv materials/testroom.mat - objects/viewmtxsurf.rad \
	objects/daymtxsurf.rad skies/sky_white.rad > octs/model_allblack.oct

time genklemsamp -c 1000 -vd 0 -1 0 objects/daymtxsurf.rad | \
	rcontrib -n $procs -c 1000 -ab 0 -e MF:1 -f reinhart.cal -b rbin -bn Nrbins \
		-m sky_glow octs/model_allblack.oct > matrices/daylightmatrix_direct.dmx

### Section 6.7 - Direct sun coefficient matrix (Cds)
printf "\nDirect Sun Coefficient Matrix\n"
echo void light solar 0 0 3 1e6 1e6 1e6 > skies/suns.rad
cnt 5185  |  rcalc -e MF:6 -f reinsrc.cal -e Rbin=recno \
	-o 'solar source sun 0 0 4 ${ Dx } ${ Dy } ${ Dz } 0.533' >> skies/suns.rad

xform -m black objects/testroom_Swall.rad objects/testroom.rad objects/ground.rad \
	| oconv materials/testroom.mat - objects/glazing.rad objects/venetianblind.rad \
		objects/glazing_bsdf.rad skies/suns.rad > octs/model_suns.oct

time rcontrib < data/photocells.pts -n $procs -I -ab 1 -ad 65536 -lw 1.52e-5 -dc 1 -dt 0 -dj 0 -st 1 -ss 0 -faf  \
	-e MF:6 -f reinhart.cal -b rbin -bn Nrbins -m solar \
	octs/model_suns.oct > matrices/directsun.dsmx

### Section 6.8 - Putting it all together
printf "\nCombining it all\n"
epw2wea skies/USA_CA_Oakland.Intl.AP.724930_TMY3.epw skies/OakLand.wea
gendaymtx -of skies/OakLand.wea > matrices/OakLand.smx
gendaymtx -of -d skies/OakLand.wea > matrices/OakLand_direct.smx
gendaymtx -5 -d -m 6 -of skies/OakLand.wea > matrices/OakLand_direct_m6.smx

time dctimestep -n 8760 -if matrices/viewmatrix.vmx bsdf/fullwindow.xml  \
	matrices/daylightmatrix.dmx matrices/OakLand.smx | \
	rcollate -h -oc 1 > i_3ph.txt

time dctimestep -n 8760 -if  matrices/viewmatrix_direct.vmx bsdf/fullwindow.xml  \
	matrices/daylightmatrix_direct.dmx matrices/OakLand_direct.smx | \
	rcollate -h -oc 1 > i_ds3ph.txt

time dctimestep -n 8760 -if matrices/directsun.dsmx matrices/OakLand_direct_m6.smx | \
	rcollate -h -oc 1 > i_ds5ph.txt

rlam i_3ph.txt i_ds3ph.txt i_ds5ph.txt | \
	rcalc -e 'r=$1-$4+$7;g=$2-$5+$8;b=$3-$6+$9' \
	-e '$1=179*(.265*r+.670*g+.065*b)' | \
	rcollate -h -fa1 -ic 8760 -t > illum.txt

printf "\nAll done with example 1!  look at illum.txt for the result.\n"


printf "\n\n\nDoing 5-phase simulation for rendering...\n"
### 7.1	View matrix (V)
printf "\nView Matrix...\n"
time vwrays -vf views/back.vf  -ff -x 500 -y 500 \
	| rcontrib `vwrays -vf views/back.vf  -x 500 -y 500 -d` -n $procs -ffc -fo -o viewpics/back_%03d.hdr \
		-f klems_int.cal -b kbinS -bn Nkbins -m viewsurf \
		-ab 10 -ad 65536 -lw 1.52e-5 octs/model_3ph.oct

### 7.2	Direct view matrix (Vd)	
printf "\nDirect View Matrix...\n"	
time vwrays -vf views/back.vf  -ff -x 500 -y 500 \
	| rcontrib `vwrays -vf views/back.vf  -x 500 -y 500 -d` -n $procs -ffc -fo -o viewpics_dir/back_%03d.hdr \
		-f klems_int.cal -b kbinS -bn Nkbins -m viewsurf \
		-ab 1 -ad 65536 -lw 1.52e-5 octs/model_3ph.oct

### 7.5	Direct sun coefficient matrix (Cds)
printf "\nDirect Coefficient Matrix...\n"
ulimit -n 9999
xform -m black objects/testroom_Swall.rad objects/testroom.rad objects/ground.rad | \
	oconv materials/testroom.mat - objects/venetianblind.rad > octs/model_nosuns.oct
time vwrays -c 4 -pj 1 -fa -vf views/back.vf -x 500 -y 500 | \
	rtrace -h- -opn -faa -ab 0 octs/model_nosuns.oct | \
	rcontrib `vwrays -vf views/back.vf -x 500 -y 500 -d` -n $procs -fac -fo -o viewpics_ds/back_%04d.hdr \
	-e MF:6 -f reinhart.cal -b rbin -bn Nrbins -m solar -c 4 -I -ab 1 -ad 100 -dt 0 -dc 1 -lw 1e-2 octs/model_suns.oct

oconv materials/testroom.mat objects/testroom_Swall.rad objects/testroom.rad \
	objects/ground.rad objects/glazing.rad objects/venetianblind.rad \
	objects/daymtxsurf.rad > octs/model_material.oct
time rpict -x 1000 -y 1000 -vf views/back.vf -ps 1 -pj 1 -av 0.31831 0.31831 0.31831 -aa 0 \
	octs/model_material.oct | pfilt -x /2 -y /2 -1 -e 1 > materialmap.hdr  

### 7.6	Putting it all together
printf "\nPutting it together...\n"
time dctimestep -n 8760 -if -o hourlypics/back_%04d.hdr viewpics/back_%03d.hdr \
	bsdf/fullwindow.xml matrices/daylightmatrix.dmx matrices/OakLand.smx 

time dctimestep -n 8760 -if -o hourlypics_dir/back_%04d.hdr viewpics_dir/back_%03d.hdr \
	bsdf/fullwindow.xml matrices/daylightmatrix_direct.dmx matrices/OakLand_direct.smx 

time dctimestep -n 8760 -if -o hourlypics_ds/back_%04d.hdr viewpics_ds/back_%04d.hdr \
	matrices/OakLand_direct_m6.smx

time for t in {1..8760} 
do ts=`printf %04d $t `
pcomb -e 'lo=li(1)-li(2)+li(3)*li(4)' -o hourlypics/back_${ts}.hdr -o hourlypics_dir/back_${ts}.hdr \
	-o hourlypics_ds/back_${ts}.hdr -o materialmap.hdr > hourlyresult/back_${ts}.hdr 
done
printf "\nAll Done with 5-phase Rendering sim\n"
pcond hourlyresult/back_0015.hdr | ximage &""")  # disabled

cluster = Cluster(L=execute_ssh_async_2.Stdout)
obj2rad = ObjToRad(ObjFiles=mesh2obj.ObjFiles, MapFile=mesh2obj.MapFile, Run=mesh2obj.Run)  # -> Status, RadFiles, Run
cluster_2 = Cluster(L=overrides_3.Output)
panel_19 = Panel(cluster)
execute_ssh_async_3 = ExecuteSSHAsync(SSHCommands=overrides_3.Output, Run=obj2rad.Run)  # -> Stdout, Stderr, Log, Pid, Ran
panel_20 = Panel(cluster_2)
cluster_3 = Cluster(L=execute_ssh_async_3.Stdout)
item = ListItem(List=flatten(execute_ssh_async_3.Stdout), Index=0, Wrap=True)  # -> Item, Item1
panel_21 = Panel(cluster_3)

cull = CullPattern(List=graft(layer_name), CullPattern=graft(python.is_transparent))  # -> simplify(List)
cull_2 = CullPattern(List=geo, CullPattern=python.is_transparent)
python_2 = GhPythonScript(layer_name=cull)  # -> out, transmittance, name
# ---------- python_2: Python ----------
__author__ = "mm1013"
__version__ = "2022.01.16"

import rhinoscriptsyntax as rs

try:
    transmittance = layer_name.split("_")[-1].replace("%","")
    name = layer_name.replace("%","")
except:
    transmittance = None
    name = None
# ---------- end python_2 ----------
clean = CleanTree(
    RemoveNulls=True,
    RemoveInvalid=True,
    RemoveEmpty=True,
    Tree=simplify(cull_2),
    SynchronousTree1=simplify(python_2.name),
    SynchronousTree2=simplify(python_2.transmittance))  # -> Tree, SynchronousTree1, SynchronousTree2
mesh_2 = MeshBrep(
    Brep=clean.Tree,
    Settings={GridMaxCount=0, GridMinCount=16, JaggedSeams=False, MaxEdgeLength=0, MinEdgeLength=0.0001, MinTolerance=0, Refine=True, RefineAngle=0, RelativeTolerance=0.65, SimplePlanes=True, Tolerance=0})
transmittance = Number(expr("x/100", clean.SynchronousTree2))
name = Text(clean.SynchronousTree1)
geo_2 = Geometry(mesh_2)

imageviewer = LBImageViewer(ImagePath_=item.Item1, _scale_=1, DisableClickable=False, SaveImgWithCoords=False, scale=1)  # -> ImagePath, Values, GIF
panel_22 = Panel(execute_ssh_async_3.Stderr)

cull_3 = CullPattern(List=graft(layer_name), CullPattern=graft(python.is_opaque))  # -> simplify(List)
cull_4 = CullPattern(List=geo, CullPattern=graft(python.is_opaque))  # -> simplify(List)
panel_23 = Panel(cull_3)
python_3 = GhPythonScript(layer_name=panel_23)  # -> out, reflectance
# ---------- python_3: Python ----------
__author__ = "mm1013"
__version__ = "2022.01.16"

import rhinoscriptsyntax as rs
try:
    reflectance = layer_name.split("_")[-1]
    
except:
    reflectance = None
# ---------- end python_3 ----------
clean_2 = CleanTree(
    RemoveNulls=True,
    RemoveInvalid=True,
    RemoveEmpty=True,
    Tree=cull_3,
    SynchronousTree1=cull_4,
    SynchronousTree2=python_3.reflectance)  # -> Tree, SynchronousTree1, SynchronousTree2
geo_3 = Geometry(clean_2.SynchronousTree1)
refl = Number(clean_2.SynchronousTree2)
name_2 = Text(clean_2.Tree)

imageviewer_2 = LBImageViewer(ImagePath_=item.Item, _scale_=1, DisableClickable=False, SaveImgWithCoords=False, scale=1)  # -> ImagePath, Values, GIF
panel_24 = Panel(refl)
walls = Geometry(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)
floor = Geometry(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)
panel_25 = Panel("""Floors
Walls""")
panel_26 = Panel(name)
mesh_3 = Mesh(floor)
mesh_4 = Mesh(walls)
mesh_5 = Mesh(geo_2)
graft = GraftTree(Tree=panel_25, IncludeEmptyLists=True, IncludeNullItems=True)
entwine = Entwine(Branch00=mesh_3, Branch01=mesh_4, FlattenInputs=True)
concat = Concatenate(FragmentA=panel_26, FragmentB="_mat")
preview = CustomPreview(Geometry=mesh_5, Material=ColourSwatch(SwatchColor=RGBA(35, 174, 186, 25)))
# export PATH=$PATH.:/usr/local/radiance/bin
# export RAYPATH=.:/usr/local/radiance/lib
# obj2rad -m /home/mss/simulation/mapping.map -f /home/mss/simulation/twoMeshes4.obj 2>&1 1>/home/mss/simulation/x.rad
# head /home/mss/simulation/x.rad
panel_27 = Panel("""export PATH=$PATH.:/usr/local/radiance/bin
export RAYPATH=.:/usr/local/radiance/lib
objline ~/simulation/twoMeshes5.rad | meta2tga -x 1048 -y 1048 | ra_t8 -r > ~/simulation/test.hdr
normtiff ~/simulation/test.hdr ~/simulation/test.tif
convert ~/simulation/test.tif ~/simulation/test.png
echo "C:\Users\mm1013\simulation\test.png"
""")
preview_2 = CustomPreview(Geometry=geo_3, Material=ColourSwatch(SwatchColor=RGBA(64, 64, 64, 123)))

# ----
# Grid
cull_5 = CullPattern(List=graft(layer_name), CullPattern=graft(python.is_grid))  # -> simplify(List)
cull_6 = CullPattern(List=geo, CullPattern=python.is_grid)
grid_size_2 = Number(docunits_2)
offset = Number(docunits)
clean_3 = CleanTree(RemoveNulls=True, RemoveInvalid=True, RemoveEmpty=True, Tree=cull_5, SynchronousTree1=simplify(cull_6))  # -> Tree, SynchronousTree1
geo_4 = Geometry(graft(clean_3.SynchronousTree1))
rectangle = Rectangle(Plane=PlaneXY(0, 0, 0), XSize=Domain(-1, 1), YSize=Domain(-2, 2), Radius=0)  # -> Rectangle, Length
flip = Flip(Surface=geo_4, Guide=rectangle.Rectangle)  # -> Surface, Result
custom_mesh_settings = SettingsCustom(
    StitchSeams=True,
    SimplePlanes=False,
    Refine=True,
    MinCount=16,
    MaxCount=400,
    AspectRatio=20,
    MaxDistance=0,
    MaxAngle=20,
    MinEdge=grid_size_2,
    MaxEdge=grid_size_2)
normals = Normals(geo=flip.Surface, amplitude=offset)  # -> center_2, norm_2, P
mesh_6 = MeshBrep(Brep=flip.Surface, Settings=custom_mesh_settings)
move = Move(Geometry=mesh_6, Motion=normals.norm_2)  # -> Geometry, Transform

falsestart_3 = LBFalseStartToggle(False)  # disabled
falsestart_4 = LBFalseStartToggle(True)

# ----
# Create working folder
panel_28 = Panel("mkdir -p <proj>;echo <proj>")
applyglobals = ApplyGlobals(Input=panel_28)  # -> Output, Pairs
execute_ssh_async_4 = ExecuteSSHAsync(SSHCommands=applyglobals.Output, Run=falsestart_4, stdouts="/home/mss/simulation/test_project")  # -> Stdout, Stderr, Log, Pid, Ran

item_2 = ListItem(List=geo_3, Index=0, Wrap=True)
execute_ssh_async_5 = ExecuteSSHAsync(SSHCommands=panel_27, Run=falsestart_3)  # -> Stdout, Stderr, Log, Pid, Ran; disabled
long = LongestList(ListA=item_2, ListB="blackMaterial", PaddingMode=2)  # -> ListA, ListB
imageviewer_3 = LBImageViewer(ImagePath_=execute_ssh_async_5.Stdout, _scale_=1, DisableClickable=False, SaveImgWithCoords=False, scale=1)  # -> ImagePath, Values, GIF; disabled
concat_2 = Concatenate(FragmentA=name_2, FragmentB="_black")
concat_3 = Concatenate(FragmentA=name_2, FragmentB="_mat")

# ----
# window geometry
mesh2obj_2 = MeshToObj(Mesh=mesh_5, Name=panel_26, ModifierName=concat, Run=execute_ssh_async_4.Ran)  # -> ObjFiles, MapFile, Run
obj2rad_2 = ObjToRad(ObjFiles=mesh2obj_2.ObjFiles, MapFile=mesh2obj_2.MapFile, Run=mesh2obj_2.Run)  # -> Status, RadFiles, Run

# ----
# Geometry
mesh2obj_3 = MeshToObj(Mesh=geo_3, Name=name_2, ModifierName=concat_3, Run=execute_ssh_async_4.Ran)  # -> ObjFiles, MapFile, Run
obj2rad_3 = ObjToRad(ObjFiles=mesh2obj_3.ObjFiles, MapFile=mesh2obj_3.MapFile, Run=mesh2obj_3.Run)  # -> Status, RadFiles, Run

# ----
# Black Geometry
mesh2obj_4 = MeshToObj(Mesh=geo_3, Name=concat_2, ModifierName=long.ListB, Run=execute_ssh_async_4.Ran)  # -> ObjFiles, MapFile, Run
# Sun
obj2rad_4 = ObjToRad(ObjFiles=mesh2obj_4.ObjFiles, MapFile=mesh2obj_4.MapFile, Run=mesh2obj_4.Run)  # -> Status, RadFiles, Run

panel_29 = Panel(execute_ssh_async_5.Stderr)  # disabled

# ----
# grid points
facen_2 = FaceNormals(Mesh=move.Geometry)  # -> Centers, Normals
points2pts = PointsToPts(Points=flatten(facen_2.Centers), Vectors=facen_2.Normals, Name="points", Run=execute_ssh_async_4.Ran)  # -> PtsFile, Run
lng = ListLength(List=flatten(facen_2.Centers))
ptscount = Integer(lng)
points_2 = Text(points2pts.PtsFile)

applyglobals_2 = ApplyGlobals(Input="<proj>")  # -> Output, Pairs

# ----
# Setup a viewfile (camera)
panel_30 = Panel("MyCamera")
view = CreateView(Viewport=panel_30)  # -> ViewfileContent, ImageRatio
panel_31 = Panel(view.ViewfileContent)
panel_32 = Panel("""vf
target""")
entwine_2 = Entwine(Branch00=view.ViewfileContent, Branch01="viewfile.vf", FlattenInputs=True)  # -> flatten(Result)
applyglobals_3 = ApplyGlobals(Input="echo \"<vf>\" > <proj>/<target>;echo \"<proj>/<target>\"", AdditionalKeys=panel_32, AdditionalValues=entwine_2)  # -> Output, Pairs
execute_ssh_async_6 = ExecuteSSHAsync(SSHCommands=applyglobals_3.Output, Run=execute_ssh_async_4.Ran, stdouts="~/simulation/test_project/viewfile.vf")  # -> Stdout, Stderr, Log, Pid, Ran
viewfile = Text(execute_ssh_async_6.Stdout)

rep = ReplaceText(Text=applyglobals_2.Output, Find="~/", RecursiveReplace=False)

# ----
# WEA file
# create WEA file
epw_file_path = FilePath("C:\ladybug\NOR_OS_Alna.014870_TMYx.2004-2018\NOR_OS_Alna.014870_TMYx.2004-2018.epw")
upload = Upload(LocalFilePaths=epw_file_path, SubfolderOverride=rep, Run=execute_ssh_async_4.Ran)  # -> Status, FilePaths, Run
rep_2 = ReplaceText(Text=upload.FilePaths, Find=".epw", Replace=".wea", RecursiveReplace=False)
panel_33 = Panel("""in
out""")
applyglobals_4 = ApplyGlobals(Input="epw2wea <in> <out> 1>&2;echo <out>", AdditionalKeys=panel_33, AdditionalValues=[upload.FilePaths, rep_2])  # -> Output, Pairs
execute_ssh_async_7 = ExecuteSSHAsync(
    SSHCommands=applyglobals_4.Output,
    Run=upload.Run,
    stdouts="/home/mss/simulation/test_project/NOR_OS_Alna.014870_TMYx.2004-2018.wea")  # -> Stdout, Stderr, Log, Pid, Ran
file_exists = Panel("[ -f <out> ] && echo \"1\" || echo \"0\"")
panel_34 = Panel(execute_ssh_async_7.Stderr)
panel_35 = Panel(execute_ssh_async_7.Stdout)
applyglobals_5 = ApplyGlobals(Input=file_exists, AdditionalKeys="out", AdditionalValues=execute_ssh_async_7.Stdout)  # -> Output, Pairs
execute_ssh_async_8 = ExecuteSSHAsync(SSHCommands=applyglobals_5.Output, Run=upload.Run, stdouts="1")  # -> Stdout, Stderr, Log, Pid, Ran
wea_file = Text(execute_ssh_async_7.Stdout)

# ----
# Setup glass materials
panel_36 = Panel("0.8")
glassmat = GlassMat(Name=concat, Transmittance_0_1=transmittance)  # -> RadMaterials, RadMaterialList
panel_37 = Panel("""mats
target""")
entwine_3 = Entwine(Branch00=glassmat.RadMaterials, Branch01="glass_materials.rad", FlattenInputs=True)  # -> flatten(Result)
applyglobals_6 = ApplyGlobals(Input="echo \"<mats>\" > <proj>/<target>;echo \"<proj>/<target>\"", AdditionalKeys=panel_37, AdditionalValues=entwine_3)  # -> Output, Pairs
execute_ssh_async_9 = ExecuteSSHAsync(SSHCommands=applyglobals_6.Output, Run=obj2rad_3.Run, stdouts="~/simulation/test_project/glass_materials.rad")  # -> Stdout, Stderr, Log, Pid, Ran
window_mat = Text(execute_ssh_async_9.Stdout)
window_rad = Text(obj2rad_2.RadFiles)

# ----
# blackmaterials
panel_38 = Panel("0.0")
black_rad_files = Text(obj2rad_4.RadFiles)
opaquegreymat = OpaqueGreyMat(Name=flatten("blackMaterial"), Reflectance_0_1=panel_38, Specularity=0, Roughness=0)  # -> RadMaterials, RadMaterialList
panel_39 = Panel("""mats
target""")
entwine_4 = Entwine(Branch00=opaquegreymat.RadMaterials, Branch01="blackmats.mat", FlattenInputs=True)  # -> flatten(Result)
applyglobals_7 = ApplyGlobals(Input="echo \"<mats>\" ><proj>/<target>;echo \"<proj>/<target>\"", AdditionalKeys=panel_39, AdditionalValues=entwine_4)  # -> Output, Pairs
execute_ssh_async_10 = ExecuteSSHAsync(SSHCommands=applyglobals_7.Output, Run=obj2rad_4.Run, stdouts="~/simulation/test_project/blackmats.mat")  # -> Stdout, Stderr, Log, Pid, Ran
black_rad_files_2 = Text(black_rad_files)
black_mat = Text(execute_ssh_async_10.Stdout)

# ----
# create black octree
black_rad_files_3 = Text(black_rad_files_2)
window_mat_2 = Text(window_mat)
black_mat_2 = Text(black_mat)
window_rad_2 = Text(window_rad)
and = GateAnd(A=execute_ssh_async_9.Ran, B=execute_ssh_async_10.Ran)
panel_40 = Panel("oconv -f <rads> > ~/simulation/myscene_black.oct;echo ~/simulation/myscene_black.oct")
entwine_5 = Entwine(Branch00=window_mat_2, Branch01=window_rad_2, Branch02=black_mat_2, Branch03=black_rad_files_3, FlattenInputs=True)  # -> flatten(Result)
join = TextJoin(Text=flatten(entwine_5), Join=" ")
rep_3 = ReplaceText(Text=panel_40, Find="<rads>", Replace=join, RecursiveReplace=False)
execute_ssh_async_11 = ExecuteSSHAsync(SSHCommands=rep_3, Run=and, stdouts="/home/mss/simulation/myscene_black.oct")  # -> Stdout, Stderr, Log, Pid, Ran
panel_41 = Panel(execute_ssh_async_11.Stdout)
octree_black = Text(execute_ssh_async_11.Stdout)

window_rad_3 = Text(window_rad)
panel_42 = Panel("""export PATH=$PATH.:/usr/local/radiance/bin
export RAYPATH=.:/usr/local/radiance/lib
objview -v <vf> <octree>""")
panel_43 = Panel("""export PATH=$PATH.:/usr/local/radiance/bin
export RAYPATH=.:/usr/local/radiance/lib
objline <rads> | meta2tga -x 1048 -y 1048 | ra_t8 -r > <proj>/<target>.hdr
normtiff <proj>/<target>.hdr <proj>/<target>.tif
convert <proj>/<target>.tif <proj>/<target>.png
echo "<proj>/<target>.png"
""")

# ----
# Annual sky-matrix 145 patches
wea_file_2 = Text(wea_file)
# Skies and Skymatrices
panel_44 = Panel("gendaymtx -m 1 \"<wea>\" > <smx>;echo \"<smx>\"")
rep_4 = ReplaceText(Text=wea_file_2, Find=".wea", Replace=".smx", RecursiveReplace=False)
panel_45 = Panel("""wea
smx""")
applyglobals_8 = ApplyGlobals(Input=panel_44, AdditionalKeys=panel_45, AdditionalValues=[wea_file_2, rep_4])  # -> Output, Pairs
execute_ssh_async_12 = ExecuteSSHAsync(
    SSHCommands=applyglobals_8.Output,
    Run=execute_ssh_async_8.Ran,
    stdouts="/home/mss/simulation/test_project/NOR_OS_Alna.014870_TMYx.2004-2018.smx")  # -> Stdout, Stderr, Log, Pid, Ran
panel_46 = Panel(execute_ssh_async_12.Stdout)
sky_matrix = Text(execute_ssh_async_12.Stdout)

# ----
# Sun matrix with 5165 suns
wea_file_3 = Text(wea_file)
panel_47 = Panel("gendaymtx -5 0.533 -d -m 6 \"<wea>\" > <smx>;echo \"<smx>\"")
rep_5 = ReplaceText(Text=wea_file_3, Find=".wea", Replace="sunM6.smx", RecursiveReplace=False)
panel_48 = Panel("""wea
smx""")
applyglobals_9 = ApplyGlobals(Input=panel_47, AdditionalKeys=panel_48, AdditionalValues=[wea_file_3, rep_5])  # -> Output, Pairs
execute_ssh_async_13 = ExecuteSSHAsync(
    SSHCommands=applyglobals_9.Output,
    Run=execute_ssh_async_8.Ran,
    stdouts="/home/mss/simulation/test_project/NOR_OS_Alna.014870_TMYx.2004-2018sunM6.smx")  # -> Stdout, Stderr, Log, Pid, Ran
panel_49 = Panel(execute_ssh_async_13.Stdout)

# ----
# Annual direct only daylight matrix with 145 patches
wea_file_4 = Text(wea_file)
rep_6 = ReplaceText(Text=wea_file_4, Find=".wea", Replace="d.smx", RecursiveReplace=False)
panel_50 = Panel("""wea
smx""")
applyglobals_10 = ApplyGlobals(
    Input="gendaymtx -m 1 -d \"<wea>\" > <smx>;echo \"<smx>\"",
    AdditionalKeys=panel_50,
    AdditionalValues=[wea_file_4, rep_6])  # -> Output, Pairs
execute_ssh_async_14 = ExecuteSSHAsync(
    SSHCommands=applyglobals_10.Output,
    Run=execute_ssh_async_8.Ran,
    stdouts="/home/mss/simulation/test_project/NOR_OS_Alna.014870_TMYx.2004-2018d.smx")  # -> Stdout, Stderr, Log, Pid, Ran
panel_51 = Panel(execute_ssh_async_14.Stdout)

panel_52 = Panel("""target
rads""")
panel_53 = Panel("""rads
target""")
panel_54 = Panel("""vf
octree""")

# ----
# Create skyglow.rad
panel_55 = Panel("skyglow.rad")
panel_56 = Panel("""#@rfluxmtx u=+Y h=u
void glow groundglow
0
0
4 1 1 1 0

groundglow source ground
0
0
4 0 0 -1 180

#@rfluxmtx u=+Y h=r1
void glow skyglow
0
0
4 1 1 1 0

skyglow source skydome
0
0
4 0 0 1 180""")
panel_57 = Panel("echo \"<skyglow>\" > <proj>/<target>; echo \"<proj>/<target>\"")
panel_58 = Panel("""skyglow
target""")
applyglobals_11 = ApplyGlobals(Input=panel_57, AdditionalKeys=panel_58, AdditionalValues=[panel_56, panel_55])  # -> Output, Pairs
execute_ssh_async_15 = ExecuteSSHAsync(SSHCommands=applyglobals_11.Output, Run=execute_ssh_async_4.Ran, stdouts="~/simulation/test_project/skyglow.rad")  # -> Stdout, Stderr, Log, Pid, Ran
applyglobals_12 = ApplyGlobals(Input="head <target>", AdditionalKeys="target", AdditionalValues=execute_ssh_async_15.Stdout)  # -> Output, Pairs
execute_ssh_async_16 = ExecuteSSHAsync(
    SSHCommands=applyglobals_12.Output,
    Run=execute_ssh_async_15.Ran,
    stdouts="""#@rfluxmtx u=+Y h=u
void glow groundglow
0
0
4 1 1 1 0

groundglow source ground
0
0
4 0 0 -1 180""")  # -> Stdout, Stderr, Log, Pid, Ran
panel_59 = Panel(execute_ssh_async_15.Stdout)
panel_60 = Panel(execute_ssh_async_16.Stdout)
skyglow = Text(execute_ssh_async_15.Stdout)

panel_61 = Panel("test")
falsestart_5 = LBFalseStartToggle(False)
falsestart_6 = LBFalseStartToggle(False)
ptscount_2 = Integer(ptscount)
ptscount_3 = Integer(ptscount)
m6_sky_mtx = Text(panel_49)
panel_62 = Panel("""C:\Users\mm1013\simulation\NRH_J_Para_LT06_Lysning07_WWR055_Facades03\daylight_factor\model\scene\envelope.mat
C:\Users\mm1013\simulation\NRH_J_Para_LT06_Lysning07_WWR055_Facades03\daylight_factor\model\scene\envelope.rad""")
radviewer = RadViewer(RadFiles=panel_62, IsTwoSided=True)  # -> Meshes, Names, ModifierNames, Modifiers, FailedWireFrame
falsestart_7 = LBFalseStartToggle(False)
panel_63 = Panel("C:\Users\mm1013\simulation\radTutorialFiles\room\results\dcDDS\annualR.ill")
panel_64 = Panel("C:\Users\mm1013\simulation\radTutorialFiles\room\points.txt")
crv = Curve(radviewer.FailedWireFrame)
panel_65 = Panel(radviewer.Modifiers)
file = ReadFile(File=panel_64, PerLineParse=True)
falsestart_8 = LBFalseStartToggle(False)
int = Integer("1")
c_script = CSharpScript(x=file)  # -> out, A; inputs x: list of String
# ---------- c_script: C# ----------
    List<Point3d> pts = new List<Point3d>(x.Count);

    for (int i = 0; i < x.Count; i++)
    {
      string[] split = x[i].Split(' ');
      pts.Add(new Point3d(double.Parse(split[0]),
        double.Parse(split[1]),
        double.Parse(split[2]))
        );
    }

    A = pts;
# ---------- end c_script ----------
dup = DuplicateData(Data=int, Number="8760", Order=True)
dup_2 = DuplicateData(Data=int, Number="40", Order=True)
analysisperiod = LBAnalysisPeriod(start_month=1, start_day=1, start_hour="8", end_hour="18")  # -> period, hoys, dates; plug-in component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
points_3 = Text(points_2)
annualresults = AnnualResults(IllFile=panel_63, Schedule=dup_2, Min="300", Max="300000000", Run=falsestart_8)  # -> Headers, Results, Ran
gradient = Gradient(
    LowerLimit="1",
    UpperLimit="0",
    Parameter=annualresults.Results,
    stops=[0: RGB(234, 38, 0), 0.25: RGB(234, 126, 0), 0.5: RGB(254, 244, 84), 0.75: RGB(173, 203, 249), 1: RGB(75, 107, 169)])
Z = UnitZ(Factor=1)
pt = Point()
long_2 = LongestList(ListA=pt, ListB=Z, PaddingMode=2)  # -> ListA, ListB
preview_3 = CustomPreview(Geometry=c_script.A, Material=gradient)
honeybee = Honeybee_Honeybee()  # -> Vviiiiiiiiiizzz; plug-in component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
toggle = BooleanToggle(False)
pt_2 = Point(pt)
falsestart_9 = LBFalseStartToggle(False)
applyglobals_13 = ApplyGlobals(Input="[ -f <file> ] && echo \"1\" || echo \"0\"", AdditionalKeys="file", AdditionalValues="~/simulation/points.pts2")  # -> Output, Pairs
execute_ssh_async_17 = ExecuteSSHAsync(SSHCommands=applyglobals_13.Output, Run=falsestart_9)  # -> Stdout, Stderr, Log, Pid, Ran
panel_66 = Panel(execute_ssh_async_17.Stdout)

panel_67 = Panel("cat ~/.bashrc")  # disabled
panel_68 = Panel("dwd | tee ~/simulation/log.txt")  # disabled
falsestart_10 = LBFalseStartToggle(False)  # disabled

execute_ssh_async_18 = ExecuteSSHAsync(SSHCommands=[panel_67, panel_68], Run=falsestart_10)  # -> Stdout, Stderr, Log, Pid, Ran; disabled

panel_69 = Panel(execute_ssh_async_18.Stdout)  # disabled
panel_70 = Panel(execute_ssh_async_18.Log)  # disabled
panel_71 = Panel(execute_ssh_async_18.Stderr)  # disabled

# ----
# Check if ximage and other x-commands work.
# Must have Xlaunch running on windows with disabled access control
# Otherwise it will crash!
panel_72 = Panel("""export "DISPLAY=$(ip route list default | awk '{print $3}'):0"
export "LIBGL_ALWAYS_INDIRECT=1"
xclock""")
falsestart_11 = LBFalseStartToggle(False)

execute_ssh_async_19 = ExecuteSSHAsync(SSHCommands=panel_72, Run=falsestart_11)  # -> Stdout, Stderr, Log, Pid, Ran
panel_73 = Panel(execute_ssh_async_19.Log)

panel_74 = Panel(execute_ssh_async_19.Stderr)

# ----
# sun primitive
panel_75 = Panel("""export PATH=$PATH.:/usr/local/radiance/bin
export RAYPATH=.:/usr/local/radiance/lib
echo "void light solar 0 0 3 1e6 1e6 1e6" > <target>
echo "<target>"
""")

applyglobals_14 = ApplyGlobals(Input=panel_75, AdditionalKeys="target", AdditionalValues="~/simulation/suns.rad")  # -> Output, Pairs
panel_76 = Panel("""export PATH=$PATH.:/usr/local/radiance/bin
export RAYPATH=.:/usr/local/radiance/lib
cnt 5165 | rcalc -e MF:6 -f reinsrc.cal -e Rbin=recno -o 'solar source sun 0 0 4 ${Dx} ${Dy} ${Dz} 0.553' >> <target>
echo <target>""")

execute_ssh_async_20 = ExecuteSSHAsync(SSHCommands=applyglobals_14.Output, Run=execute_ssh_async_4.Ran, stdouts="~/simulation/suns.rad")  # -> Stdout, Stderr, Log, Pid, Ran

# ----
# solar discs and modifiers for 5165 suns (=MF:6)
panel_77 = Panel("target")
applyglobals_15 = ApplyGlobals(Input=panel_76, AdditionalKeys=panel_77, AdditionalValues=execute_ssh_async_20.Stdout)  # -> Output, Pairs
execute_ssh_async_21 = ExecuteSSHAsync(SSHCommands=applyglobals_15.Output, Run=execute_ssh_async_20.Ran, stdouts="/home/mss/simulation/suns.rad")  # -> Stdout, Stderr, Log, Pid, Ran

# ----
# Setup materials
opaque_rad = Text(obj2rad_3.RadFiles)
# rad files (incl mats)
panel_78 = Panel("echo \"<mats>\" > <proj>/<target>;echo \"<proj>/<target>\"")
opaquegreymat_2 = OpaqueGreyMat(Name=concat_3, Reflectance_0_1=refl, Specularity=0, Roughness=0)  # -> flatten(RadMaterials), RadMaterialList
panel_79 = Panel("""mats
target""")
opaque_rad_2 = Text(opaque_rad)

join_2 = TextJoin(Text=opaquegreymat_2.RadMaterials)

entwine_6 = Entwine(Branch00=join_2, Branch01="opaque_materials.rad", FlattenInputs=True)  # -> flatten(Result)
applyglobals_16 = ApplyGlobals(Input=panel_78, AdditionalKeys=panel_79, AdditionalValues=entwine_6)  # -> Output, Pairs
execute_ssh_async_22 = ExecuteSSHAsync(SSHCommands=applyglobals_16.Output, Run=obj2rad_3.Run, stdouts="~/simulation/test_project/opaque_materials.rad")  # -> Stdout, Stderr, Log, Pid, Ran
opaque_mat = Text(execute_ssh_async_22.Stdout)

# ----
# 2phase DDS simulation
opaque_rad_3 = Text(opaque_rad_2)
radfiles = Text([window_rad_3, opaque_rad_3])
join_3 = TextJoin(Text=flatten(radfiles), Join=" ")
entwine_7 = Entwine(Branch00=join_3, Branch01="test", FlattenInputs=True)  # -> flatten(Result)
overrides_4 = ApplyOverrides(Input=panel_43, AdditionalKeys=panel_53, AdditionalValues=entwine_7)  # -> Output, Pairs
execute_ssh_async_23 = ExecuteSSHAsync(SSHCommands=overrides_4.Output, Run=falsestart_6, stdouts="~/simulation/test_project/test.png")  # -> Stdout, Stderr, Log, Pid, Ran
panel_80 = Panel(execute_ssh_async_23.Stdout)

imageratio = Panel(view.ImageRatio)
# VWRAYS
width_pixels = Panel("500")
subfolder = Panel("matrices")
# (converting pixels to rays for rcontrib)
division = Division(A=width_pixels, B=imageratio)
height = Integer(division)
skyglow_2 = Text(skyglow)
viewfile_2 = Text(viewfile)
panel_81 = Panel("""vf
width
height
skydome
octree
subfolder
target""")
panel_82 = Panel("mkdir -p <proj>/<subfolder>;vwrays -vf <vf> -x <width> -y <height> -pj 0.7 -c 9 -ff | rfluxmtx -ffc -v -n <cpus> `vwrays -vf <vf> -x <width> -y <height> -d` -c 9 -ab 4 -ad 10000 -lw 0.0001 -o <proj>/<subfolder>/<target> - <skydome> -i <octree>;echo true")
falsestart_12 = LBFalseStartToggle(True)
and_2 = GateAnd(A=execute_ssh_async_15.Ran, B=execute_ssh_async_6.Ran)
or = GateOr(A=and_2, B=falsestart_12)

# ----
# Skyvector - point in time
# new york data on a certain date
panel_83 = Panel("gendaylit 3 20 10:30EDT -m 75 -o 73.96 -a 40.78 -W 706 162 | genskyvec -m 1 > <proj>/<target>;echo \"<proj>/<target>\"")
overrides_5 = ApplyOverrides(Input=panel_83, AdditionalKeys="target", AdditionalValues="skyvectors_NYC_m1.vec")  # -> Output, Pairs
execute_ssh_async_24 = ExecuteSSHAsync(SSHCommands=overrides_5.Output, Run=or, stdouts="~/simulation/test_project/skyvectors_NYC_m1.vec")  # -> Stdout, Stderr, Log, Pid, Ran

# ----
# Octrees
# create octree
# -f is frozen octree. Means embedded
# ressources instead of referenced.
# ++ Quicker loading and easier to relocate.
# -- More disc space required.
window_mat_3 = Text(window_mat)
opaque_mat_2 = Text(opaque_mat)
opaque_rad_4 = Text(opaque_rad_2)
window_rad_4 = Text(window_rad)
panel_84 = Panel("oconv -f <rads> > <proj>/<target>.oct;echo <proj>/<target>.oct")
and_3 = GateAnd(A=execute_ssh_async_9.Ran, B=execute_ssh_async_22.Ran)

entwine_8 = Entwine(Branch00=window_mat_3, Branch01=window_rad_4, Branch02=opaque_mat_2, Branch03=opaque_rad_4, FlattenInputs=True)  # -> flatten(Result)
join_4 = TextJoin(Text=flatten(entwine_8), Join=" ")

# ----
# create black octreeDDS
suns_material = Text(execute_ssh_async_20.Stdout)
black_rad_files_4 = Text(black_rad_files_2)
window_mat_4 = Text(window_mat)
window_rad_5 = Text(window_rad)
black_mat_3 = Text(black_mat)
mf6_suns = Text(execute_ssh_async_21.Stdout)
entwine_9 = Entwine(
    Branch00=window_mat_4,
    Branch01=window_rad_5,
    Branch02=black_mat_3,
    Branch03=black_rad_files_4,
    Branch04=suns_material,
    Branch05=mf6_suns,
    FlattenInputs=True)  # -> flatten(Result)
join_5 = TextJoin(Text=flatten(entwine_9), Join=" ")
panel_85 = Panel("""rads
target""")
applyglobals_17 = ApplyGlobals(
    Input="oconv -f <rads> > <target>;echo <target>",
    AdditionalKeys=panel_85,
    AdditionalValues=[join_5, "~/simulation/myscene_black_sunCoeffecientsDDS.oct"])  # -> Output, Pairs

execute_ssh_async_25 = ExecuteSSHAsync(
    SSHCommands=applyglobals_17.Output,
    Run=execute_ssh_async_21.Ran,
    stdouts="/home/mss/simulation/myscene_black_sunCoeffecientsDDS.oct")  # -> Stdout, Stderr, Log, Pid, Ran

panel_86 = Panel(execute_ssh_async_25.Stdout)
octree_blackdds = Text(panel_86)

join_6 = TextJoin(Text=flatten(entwine_8), Join=" ")

entwine_10 = Entwine(Branch00="roomDC", Branch01=join_6, FlattenInputs=True)  # -> flatten(Result)
applyglobals_18 = ApplyGlobals(Input=panel_84, AdditionalKeys=panel_52, AdditionalValues=entwine_10)  # -> Output, Pairs

execute_ssh_async_26 = ExecuteSSHAsync(SSHCommands=applyglobals_18.Output, Run=and_3, stdouts="/home/mss/simulation/test_project/roomDC.oct")  # -> Stdout, Stderr, Log, Pid, Ran
panel_87 = Panel(execute_ssh_async_26.Stdout)
panel_88 = Panel(execute_ssh_async_26.Ran)
octree_roomdc = Text(execute_ssh_async_26.Stdout)

octree_roomdc_2 = Text(octree_roomdc)
entwine_11 = Entwine(
    Branch00=viewfile_2,
    Branch01=width_pixels,
    Branch02=height,
    Branch03=skyglow_2,
    Branch04=octree_roomdc_2,
    Branch05=subfolder,
    Branch06="image_%04d.hdr",
    FlattenInputs=True)  # -> flatten(Result)
overrides_6 = ApplyOverrides(Input="echo \"<proj>/<subfolder>/<target>\"", AdditionalKeys=panel_81, AdditionalValues=entwine_11)  # -> Output, Pairs
overrides_7 = ApplyOverrides(Input=panel_82, AdditionalKeys=panel_81, AdditionalValues=entwine_11)  # -> Output, Pairs
execute_ssh_async_27 = ExecuteSSHAsync(SSHCommands=overrides_6.Output, Run=or, stdouts="~/simulation/test_project/image_%04d.hdr/image_%04d.hdr")  # -> Stdout, Stderr, Log, Pid, Ran
execute_ssh_async_28 = ExecuteSSHAsync(SSHCommands=overrides_7.Output, Run=or, stdouts="true")  # -> Stdout, Stderr, Log, Pid, Ran
default = DefaultMSS(data=flatten(execute_ssh_async_28.Stdout), default_value_flattened=flatten(Toggle(False)))
and_4 = GateAnd(A=or, B=default)

panel_89 = Panel(applyglobals_18.Output)
entwine_12 = Entwine(Branch00=viewfile, Branch01=execute_ssh_async_26.Stdout, FlattenInputs=True)  # -> flatten(Result)
panel_90 = Panel(execute_ssh_async_26.Stderr)
overrides_8 = ApplyOverrides(Input=panel_42, AdditionalKeys=panel_54, AdditionalValues=entwine_12)  # -> Output, Pairs
mtx = Text(execute_ssh_async_27.Stdout)
execute_ssh_async_29 = ExecuteSSHAsync(SSHCommands=overrides_8.Output, Run=falsestart_5, stdouts="~/simulation/test_project/test.png")  # -> Stdout, Stderr, Log, Pid, Ran
panel_91 = Panel(execute_ssh_async_29.Stdout)

# ----
# Generate daylight coefficients
panel_92 = Panel("/home/mss/simulation/dc_illum.mtx")
# NO GOOD METHOD (YET) OF MAKING SURE
# THESE 3 DONT RUN AT THE SAME TIME.
# 
# Unless we chain them (doing that as a temp fix)
# Raytracing (rfluxmtx)
panel_93 = Panel("""export PATH=$PATH.:/usr/local/radiance/bin
export RAYPATH=.:/usr/local/radiance/lib
rfluxmtx -I+ -y <ptcount> -lw 0.0001 -ab 5 -ad 5000 -n <cpus> - <skyglow> -i <octree> < <points> > <target>;echo <target>""")
skyglow_3 = Text(skyglow)
ptscount_4 = Integer(ptscount)
octree = Text(octree_roomdc)
points_4 = Text(points_2)
panel_94 = Panel("""points
octree
skyglow
ptcount
target""")
and_5 = GateAnd(OctreeOk=execute_ssh_async_26.Ran, SkyglowOk=execute_ssh_async_15.Ran, PointsOk=points2pts.Run)
entwine_13 = Entwine(Branch00=points_4, Branch01=octree, Branch02=skyglow_3, Branch03=ptscount_4, Branch04=panel_92, FlattenInputs=True)  # -> flatten(Result)
applyglobals_19 = ApplyGlobals(Input=panel_93, AdditionalKeys=panel_94, AdditionalValues=entwine_13)  # -> Output, Pairs
execute_ssh_async_30 = ExecuteSSHAsync(SSHCommands=applyglobals_19.Output, Run=and_5, stdouts="/home/mss/simulation/dc_illum.mtx")  # -> Stdout, Stderr, Log, Pid, Ran
panel_95 = Panel(applyglobals_19.Output)
panel_96 = Panel(execute_ssh_async_30.Stdout)

# ----
# Generate daylight coefficients black (direct only)
panel_97 = Panel("/home/mss/simulation/dcd_illum.mtx")
panel_98 = Panel("""export PATH=$PATH.:/usr/local/radiance/bin
export RAYPATH=.:/usr/local/radiance/lib
rfluxmtx -I+ -y <ptcount> -lw 0.0002 -ab 1 -ad 5000 -n <cpus> - <skyglow> -i <octree> < <points> > <target>;echo <target>""")
octree_black_2 = Text(octree_black)
skyglow_4 = Text(skyglow)
points_5 = Text(points_2)
panel_99 = Panel("""points
octree
skyglow
ptcount
target""")
and_6 = GateAnd(
    octree_ok=execute_ssh_async_11.Ran,
    skyglow_ok=execute_ssh_async_11.Ran,
    points_ok=points2pts.Run,
    ran_above=execute_ssh_async_30.Ran)
entwine_14 = Entwine(
    Branch00=points_5,
    Branch01=octree_black_2,
    Branch02=skyglow_4,
    Branch03=ptscount_2,
    Branch04=panel_97,
    FlattenInputs=True)  # -> flatten(Result)
applyglobals_20 = ApplyGlobals(Input=panel_98, AdditionalKeys=panel_99, AdditionalValues=entwine_14)  # -> Output, Pairs
execute_ssh_async_31 = ExecuteSSHAsync(SSHCommands=applyglobals_20.Output, Run=and_6, stdouts="/home/mss/simulation/dcd_illum.mtx")  # -> Stdout, Stderr, Log, Pid, Ran
panel_100 = Panel(execute_ssh_async_31.Stdout)
panel_101 = Panel(applyglobals_20.Output)

# ----
# Calculate illuminance sun coefficients for illuminance calculations
panel_102 = Panel("/home/mss/simulation/cdsDDS_illum.mtx")
# Raytracing suns (rcontrib)
panel_103 = Panel("""export PATH=$PATH.:/usr/local/radiance/bin
export RAYPATH=.:/usr/local/radiance/lib
rcontrib -I+ -ab 1 -y <ptcount> -n <cpus> -ad 256 -lw 1.0e-3 -dc 1 -dt 0 -dj 0 -faf -e MF:6 -f reinhart.cal -b rbin -bn Nrbins -m solar <octree> < <points> > <target>
echo <target>""")
octree_blackdds_2 = Text(octree_blackdds)
points_6 = Text(points_2)
panel_104 = Panel("""points
octree
ptcount
target""")
entwine_15 = Entwine(Branch00=points_6, Branch01=octree_blackdds_2, Branch02=ptscount_3, Branch03=panel_102, FlattenInputs=True)  # -> flatten(Result)
applyglobals_21 = ApplyGlobals(Input=panel_103, AdditionalKeys=panel_104, AdditionalValues=entwine_15)  # -> Output, Pairs
and_7 = GateAnd(octree_ok=execute_ssh_async_25.Ran, points_ok=points2pts.Run, ran_above=execute_ssh_async_31.Ran)
panel_105 = Panel(applyglobals_21.Output)
execute_ssh_async_32 = ExecuteSSHAsync(SSHCommands=applyglobals_21.Output, Run=and_7, stdouts="/home/mss/simulation/cdsDDS_illum.mtx")  # -> Stdout, Stderr, Log, Pid, Ran
panel_106 = Panel(execute_ssh_async_32.Stdout)

# ----
# Generate an image - point in time
panel_107 = Panel("mkdir -p <proj>/<subfolder>;dctimestep <matrices> <skyvec> > <proj>/<subfolder>/<target>;echo \"<proj>/<subfolder>/<target>\"")
panel_108 = Panel("""matrices
skyvec
subfolder
target""")
entwine_16 = Entwine(
    Branch00=mtx,
    Branch01=execute_ssh_async_24.Stdout,
    Branch02="results/dc/image",
    Branch03="testrender_x.hdr",
    FlattenInputs=True)  # -> flatten(Result)
overrides_9 = ApplyOverrides(Input=panel_107, AdditionalKeys=panel_108, AdditionalValues=entwine_16)  # -> Output, Pairs
and_8 = GateAnd(A=and_4, B=execute_ssh_async_24.Ran)
execute_ssh_async_33 = ExecuteSSHAsync(SSHCommands=overrides_9.Output, Run=and_8, stdouts="~/simulation/test_project/results/dc/image/testrender_x.hdr")  # -> Stdout, Stderr, Log, Pid, Ran
panel_109 = Panel(execute_ssh_async_33.Stdout)

panel_110 = Panel(applyglobals_21.Output)
execute_ssh_async_34 = ExecuteSSHAsync(SSHCommands=panel_110, Run=Toggle(False), stdouts="/home/mss/simulation/cdsDDS_illum.mtx")  # -> Stdout, Stderr, Log, Pid, Ran
panel_111 = Panel(execute_ssh_async_34.Stdout)
panel_112 = Panel(execute_ssh_async_34.Ran)

panel_113 = Panel(execute_ssh_async_30.Stderr)

# ----
# + Results of direct sun coefficients (5165 sample sky)
panel_114 = Panel("/home/mss/simulation/annualR_CDS.ill")
panel_115 = Panel("""export PATH=$PATH.:/usr/local/radiance/bin
export RAYPATH=.:/usr/local/radiance/lib
dctimestep <dcillum> <skymtx> | rmtxop -fa -t -c 47.4 119.9 11.6 - > <target>;echo <target>""")
panel_116 = Panel("""dcillum
skymtx
target""")
entwine_17 = Entwine(Branch00=panel_106, Branch01=m6_sky_mtx, Branch02=panel_114, FlattenInputs=True)  # -> flatten(Result)
and_9 = GateAnd(A=execute_ssh_async_32.Ran, B=execute_ssh_async_13.Ran)
applyglobals_22 = ApplyGlobals(Input=panel_115, AdditionalKeys=panel_116, AdditionalValues=entwine_17)  # -> Output, Pairs
execute_ssh_async_35 = ExecuteSSHAsync(SSHCommands=applyglobals_22.Output, Run=and_9, stdouts="/home/mss/simulation/annualR_CDS.ill")  # -> Stdout, Stderr, Log, Pid, Ran
panel_117 = Panel(applyglobals_22.Output)
panel_118 = Panel(execute_ssh_async_35.Stdout)

# ----
# - Results of daylight coefficients (direct from 145 sample sky)
panel_119 = Panel("/home/mss/simulation/annualR_DCD.ill")
panel_120 = Panel("""export PATH=$PATH.:/usr/local/radiance/bin
export RAYPATH=.:/usr/local/radiance/lib
dctimestep <dcillum> <skymtx> | rmtxop -fa -t -c 47.4 119.9 11.6 - > <target>;echo <target>""")
panel_121 = Panel("""dcillum
skymtx
target""")
entwine_18 = Entwine(Branch00=execute_ssh_async_31.Stdout, Branch01=execute_ssh_async_14.Stdout, Branch02=panel_119, FlattenInputs=True)  # -> flatten(Result)
and_10 = GateAnd(A=execute_ssh_async_14.Ran, B=execute_ssh_async_31.Ran)
applyglobals_23 = ApplyGlobals(Input=panel_120, AdditionalKeys=panel_121, AdditionalValues=entwine_18)  # -> Output, Pairs
execute_ssh_async_36 = ExecuteSSHAsync(SSHCommands=applyglobals_23.Output, Run=and_10, stdouts="/home/mss/simulation/annualR_DCD.ill")  # -> Stdout, Stderr, Log, Pid, Ran
panel_122 = Panel(applyglobals_23.Output)
panel_123 = Panel(execute_ssh_async_36.Stdout)

panel_124 = Panel("head <ill> -n 13;echo \" \";echo \"Number of lines\";wc -l <ill>")
applyglobals_24 = ApplyGlobals(Input=panel_124, AdditionalKeys="ill", AdditionalValues=execute_ssh_async_36.Stdout)  # -> Output, Pairs
execute_ssh_async_37 = ExecuteSSHAsync(
    SSHCommands=applyglobals_24.Output,
    Run=execute_ssh_async_36.Ran,
    stdouts="""#?RADIANCE
rmtxop -fa -t -c 47.4 119.9 11.6 -
dctimestep /home/mss/simulation/dcd_illum.mtx /home/mss/simulation/NOR_OS_Alna.014870_TMYx.2004-2018d.smx
CAPDATE= 2022:05:04 21:19:19
GMT= 2022:05:04 19:19:19
Applied 1x3 matrix transform
Transposed rows and columns
NROWS=8760
NCOLS=231
NCOMP=1
FORMAT=ascii

 0.000000000000000e+00	 0.000000000000000e+00	 0.000000000000000e+00	 0.000000000000000e+00	 0.000000000000000e+00	 0.000000000000000e+00	 0.000000000000000e+00	 0.000000000000000e+00	 0.000000000000000e+00	 0.000000000000000e+00	 0.000000000000000e+00	 0.000000000000000e+00	 0.000000000000000e+00	 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
 
Number of lines
8772 /home/mss/simulation/annualR_DCD.ill""")  # -> Stdout, Stderr, Log, Pid, Ran
panel_125 = Panel(execute_ssh_async_37.Stdout)

panel_126 = Panel("head <ill> -n 13;echo \" \";echo \"Number of lines\";wc -l <ill>")
applyglobals_25 = ApplyGlobals(Input=panel_126, AdditionalKeys="ill", AdditionalValues=execute_ssh_async_35.Stdout)  # -> Output, Pairs
execute_ssh_async_38 = ExecuteSSHAsync(
    SSHCommands=applyglobals_25.Output,
    Run=execute_ssh_async_35.Ran,
    stdouts="""#?RADIANCE
rmtxop -fa -t -c 47.4 119.9 11.6 -
dctimestep /home/mss/simulation/cdsDDS_illum.mtx /home/mss/simulation/NOR_OS_Alna.014870_TMYx.2004-2018sunM6.smx
CAPDATE= 2022:05:04 21:19:53
GMT= 2022:05:04 19:19:53
Applied 1x3 matrix transform
Transposed rows and columns
NROWS=8760
NCOLS=231
NCOMP=1
FORMAT=ascii

 0.000000000000000e+00	 0.000000000000000e+00	 0.000000000000000e+00	 0.000000000000000e+00	 0.000000000000000e+00	 0.000000000000000e+00	 0.000000000000000e+00	 0.000000000000000e+00	 0.000000000000000e+00	 0.000000000000000e+00	 0.000000000000000e+00	 0.000000000000000e+00	 0.000000000000000e+00	 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
 
Number of lines
8772 /home/mss/simulation/annualR_CDS.ill""")  # -> Stdout, Stderr, Log, Pid, Ran
panel_127 = Panel(execute_ssh_async_38.Stdout)

# ----
# Results of daylight coefficients
panel_128 = Panel("/home/mss/simulation/annualR_DC.ill")
# Getting results (dctimestep)
panel_129 = Panel("""export PATH=$PATH.:/usr/local/radiance/bin
export RAYPATH=.:/usr/local/radiance/lib
dctimestep <dcillum> <skymtx> | rmtxop -fa -t -c 47.4 119.9 11.6 - > <target>;echo <target>""")
panel_130 = Panel("""dcillum
skymtx
target""")
entwine_19 = Entwine(Branch00=execute_ssh_async_30.Stdout, Branch01=execute_ssh_async_12.Stdout, Branch02=panel_128, FlattenInputs=True)  # -> flatten(Result)
and_11 = GateAnd(A=execute_ssh_async_30.Ran, B=execute_ssh_async_12.Ran)
applyglobals_26 = ApplyGlobals(Input=panel_129, AdditionalKeys=panel_130, AdditionalValues=entwine_19)  # -> Output, Pairs

execute_ssh_async_39 = ExecuteSSHAsync(SSHCommands=applyglobals_26.Output, Run=and_11, stdouts="/home/mss/simulation/annualR_DC.ill")  # -> Stdout, Stderr, Log, Pid, Ran

panel_131 = Panel(execute_ssh_async_39.Stdout)

panel_132 = Panel("head <ill> -n 13;echo \" \";echo \"Number of lines\";wc -l <ill>")
applyglobals_27 = ApplyGlobals(Input=panel_132, AdditionalKeys="ill", AdditionalValues=execute_ssh_async_39.Stdout)  # -> Output, Pairs

execute_ssh_async_40 = ExecuteSSHAsync(
    SSHCommands=applyglobals_27.Output,
    Run=execute_ssh_async_39.Ran,
    stdouts="""#?RADIANCE
rmtxop -fa -t -c 47.4 119.9 11.6 -
dctimestep /home/mss/simulation/dc_illum.mtx /home/mss/simulation/NOR_OS_Alna.014870_TMYx.2004-2018.smx
CAPDATE= 2022:05:04 21:19:23
GMT= 2022:05:04 19:19:23
Applied 1x3 matrix transform
Transposed rows and columns
NROWS=8760
NCOLS=231
NCOMP=1
FORMAT=ascii

 0.000000000000000e+00	 0.000000000000000e+00	 0.000000000000000e+00	 0.000000000000000e+00	 0.000000000000000e+00	 0.000000000000000e+00	 0.000000000000000e+00	 0.000000000000000e+00	 0.000000000000000e+00	 0.000000000000000e+00	 0.000000000000000e+00	 0.000000000000000e+00	 0.000000000000000e+00	 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
 
Number of lines
8772 /home/mss/simulation/annualR_DC.ill""")  # -> Stdout, Stderr, Log, Pid, Ran

panel_133 = Panel(execute_ssh_async_40.Stdout)

# ----
# final step: Combine results
panel_134 = Panel("/home/mss/simulation/DDS_Total.ill")
panel_135 = Panel("""export PATH=$PATH.:/usr/local/radiance/bin
export RAYPATH=.:/usr/local/radiance/lib
rmtxop <DCannualR> + -s -1 <DCDannualR> + <CDSannualR> > <target>;echo <target>""")
panel_136 = Panel("""DCannualR
DCDannualR
CDSannualR
target""")
and_12 = GateAnd(A=execute_ssh_async_39.Ran, B=execute_ssh_async_36.Ran, C=execute_ssh_async_35.Ran)
entwine_20 = Entwine(
    Branch00=execute_ssh_async_39.Stdout,
    Branch01=execute_ssh_async_36.Stdout,
    Branch02=execute_ssh_async_35.Stdout,
    Branch03=panel_134,
    FlattenInputs=True)  # -> flatten(Result)
applyglobals_28 = ApplyGlobals(Input=panel_135, AdditionalKeys=panel_136, AdditionalValues=entwine_20)  # -> Output, Pairs

or_2 = GateOr(A=and_12, B=Button())

execute_ssh_async_41 = ExecuteSSHAsync(SSHCommands=applyglobals_28.Output, Run=or_2, stdouts="/home/mss/simulation/DDS_Total.ill")  # -> Stdout, Stderr, Log, Pid, Ran

list = ItemSelector(
    entwine_20,
    {"/home/mss/simulation/annualR_DC.ill", "/home/mss/simulation/annualR_DCD.ill", "/home/mss/simulation/annualR_CDS.ill", "/home/mss/simulation/DDS_Total.ill"}, selected="/home/mss/simulation/annualR_DC.ill")
or_3 = GateOr(A=execute_ssh_async_41.Ran, B=falsestart_7)
download = Download(LinuxFilePaths=list, Run=or_3)  # -> Status, FilePaths, Run
panel_137 = Panel(download.FilePaths)
annualresults_2 = AnnualResults(IllFile=download.FilePaths, Schedule=dup, Min=300, Max=0, Run=download.Run)  # -> Headers, Results, Ran
panel_138 = Panel(execute_ssh_async_41.Stdout)
bnd = Bounds(Numbers=annualresults_2.Results)
reload_analysisgrid = GhPythonScript(
    pts_file="C:\Users\mm1013\simulation\points.pts",
    ill_file=panel_137,
    hoys=analysisperiod.hoys,
    run=execute_ssh_async_41.Ran)  # -> out, analysisGrid; inputs hoys: list
# ---------- reload_analysisgrid: Python ----------
"""
    Args:
        _pts_file: Path to a points (*.pts) file
        _ill_file: Path to an illuminance (*.ill) file
        _hoys: A list of hours of the year. This should be the same list as the
            one used to run the simulation earlier.
            
            If you ran an Annual Simulation (using the Annual Daylight, Annual
            Radiation, DC-Grid Based, 3P or 5P recipe), you should provide a
            list of integers from 0 to 8759. If you used smaller timesteps in
            your simulation (e.g. using 'hoys_' input in HoneybeePlus_SkyMatrix
            component), make sure you provide a list with appropriate matching
            timesteps.
            
            If you ran a Solar Access simulation, you could use the hoys output
            from LadybugPlus_SunPath component i.e. the same you provided for the
            Solar Access Recipe.
            
            If you ran a simulation using HoneybeePlus Grid Based Recipe, you
            should enter the same hoy as was used to create the sky.
            
            You can get this _hoys list from:
            (1) LadybugPlus_SunPath component
            (2) LadybugPlus_Analysis Period component
            (3) LadybugPlus_Calculate HOY component
            (4) Standard grasshopper components
        _gridMode_: 0 > load the values. (Default)
            1 > load values as binary. Any non-zero value will be 1. Useful for studies such as Solar Access a.k.a. Sunlight Hours.
            2 > load the values divided by mode number. Use this mode for daylight factor or radiation analysis
        _run: Set to True to load the AnalysisGrid
    Returns:
        analysisGrid: Outputs a analysis grid loaded with results. Connect this
             grid to standard honeybee[+] copmonents to get the values
"""

import rhinoscriptsyntax as rs
from honeybee_plus.radiance.analysisgrid import AnalysisGrid

if _run == True:


    if _gridMode_ == None:
        gmode = 0
    else:
        gmode = int(_gridMode_)

# first let's create an analysis grid from pts file
    analysisGrid = AnalysisGrid.from_file(_pts_file)

# now let's load the results
    analysisGrid.set_values_from_file(_ill_file, hoys=_hoys, mode=gmode)
# ---------- end reload_analysisgrid ----------
panel_139 = Panel(bnd)
readannualresultsi = Honeybee_ReadAnnualResultI(
    illFilesAddress=panel_137,
    testPoints=simplify(long_2.ListA),
    ptsVectors=long_2.ListB,
    DLAIllumThresholds=300,
    runIt=download.Run)  # -> DLA, UDLI_Less_100, UDLI_100_2000, UDLI_More_2000, CDA, sDA, annualProfiles, htmReport; disabled; plug-in component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
readannualresultsiii = ReadAnnualResultsIII(resultFilesAddress=panel_137, minThreshold=300, maxThreshold=0)  # -> out, lessThanRange, inTheRange, moreThanRange, CDA; inputs resultFilesAddress: list of String, minThreshold: Double, maxThreshold: Double; disabled
# ---------- readannualresultsiii: C# usings ----------
using System.IO;
using System.Linq;
using System.Data;
using System.Drawing;
using System.Reflection;
using System.Windows.Forms;
using System.Xml;
using System.Xml.Linq;
using System.Runtime.InteropServices;

using Rhino.DocObjects;
using Rhino.Collections;
using GH_IO;
using GH_IO.Serialization;
# ---------- readannualresultsiii: C# ----------
    List < string > lines = new List<string>{};
    int ptsNumbers = 0;
    double min = minThreshold;
    double max = maxThreshold;

    var underT = new List<int>{};
    var withinT = new List<int>{};
    var aboveT = new List<int>{};

    var underTPercent = new List<double>{};
    var withinTPercent = new List<double>{};
    var aboveTPercent = new List<double>{};
    var cda = new List<double>{};

    double oneHrToPercent = 1 / 36.50;


    double infinity = 1.0 / 0.0;
    if(max == 0)max = infinity;



    for(int f = 0; f < resultFilesAddress.Count; f++){
      lines = File.ReadAllLines(resultFilesAddress[f], System.Text.Encoding.GetEncoding(1252)).ToList();

      int catecount = lines[0].Split(' ').Length - 4;


      for(int i = 0; i < catecount; i++){
        //underT.Add(0);
        //withinT.Add(0);
        //aboveT.Add(0);
        underTPercent.Add(0);
        withinTPercent.Add(0);
        aboveTPercent.Add(0);
        cda.Add(0);
      }

      for(int i = 0; i < 8760; i++){
        string [] items = lines[i].Split(' ');
        //A = items;
        var hr = Convert.ToDouble(items[2]);

        if(hr >= 8 && hr < 18){

          for(int l = 0; l < catecount; l++){
            int item = Convert.ToInt32(items[l + 4]);
            int ptsIndex = l + ptsNumbers;

            if(item < min){
              //underT[ptsIndex] += 1;
              underTPercent[ptsIndex] += oneHrToPercent;
              double factor = item / min;
              cda[ptsIndex] += oneHrToPercent * factor;
            }else if(item > max){
              //aboveT[ptsIndex] += 1;
              aboveTPercent[ptsIndex] += oneHrToPercent;
            }else{
              //withinT[ptsIndex] += 1;
              withinTPercent[ptsIndex] += oneHrToPercent;
              cda[ptsIndex] += oneHrToPercent;
            }
          }

        }
      }

      ptsNumbers += catecount;


    }



    lessThanRange = underTPercent;
    inTheRange = withinTPercent;
    moreThanRange = aboveTPercent;
    CDA = cda;
# ---------- end readannualresultsiii ----------
readannualresultsiii_2 = ReadAnnualResultsIII(resultFilesAddress=panel_137, workingHours=[8, 9, 10, 11, 12, 13, 14, 15, 16, 17], minThreshold=300, maxThreshold=0)  # -> out, lessThanRange, inTheRange, moreThanRange, CDA; inputs resultFilesAddress: list of String, workingHours: list of Int32, minThreshold: Double, maxThreshold: Double; disabled
# ---------- readannualresultsiii_2: C# ----------
    Component.Message = "VER 0.0.61\nJUL_06_2017";
    List < string > lines = new List<string>{};
    //int ptsNumbers = 0;
    min = minThreshold;
    max = maxThreshold;
    hours = workingHours;
    oneHrToPercent = 1 / (3.65*hours.Count);

    var AllProcessedData = new List<List<List<double>>>();

    var underTPercent = new List<double>{};
    var withinTPercent = new List<double>{};
    var aboveTPercent = new List<double>{};
    var cda = new List<double>{};


    double infinity = 1.0 / 0.0;
    if(max == 0)max = infinity;

    var illResults = resultFilesAddress.AsParallel().AsOrdered().Select(file => readIllFile(file));
    foreach (var illResult in illResults)
    {
      underTPercent.AddRange(illResult[0]);
      withinTPercent.AddRange(illResult[1]);
      aboveTPercent.AddRange(illResult[2]);
      cda.AddRange(illResult[3]);
    }

    lessThanRange = underTPercent;
    inTheRange = withinTPercent;
    moreThanRange = aboveTPercent;
    CDA = cda;
# ---------- readannualresultsiii_2: C# additional code ----------
  static double min = 300;
  static double max = 0;
  static double oneHrToPercent= 1 / 36.50;
  static List<int> hours;

  static List < List < double >> readIllFile (object file)
  {

    var underTPercent = new List<double>(){};
    var withinTPercent = new List<double>(){};
    var aboveTPercent = new List<double>(){};
    var cda = new List<double>{};
    var lines = File.ReadAllLines((String) file, System.Text.Encoding.GetEncoding(1252)).ToList();

    int ptsCount = lines[0].Split(' ').Length - 4;

    for(int i = 0; i < ptsCount; i++){

      underTPercent.Add(0);
      withinTPercent.Add(0);
      aboveTPercent.Add(0);
      cda.Add(0);
    }

    for(int i = 0; i < 8760; i++){
      string [] items = lines[i].Split(' ');
      //A = items;
      var hr = (int) Convert.ToDouble(items[2]);
      
      //var hrs = new List<int>(){8,9,10};
      int pos = hours.IndexOf(hr);

      if(pos >= 0){

        for(int l = 0; l < ptsCount; l++){
          int item = Convert.ToInt32(items[l + 4]);
          int ptsIndex = l;

          //underTPercent
          if(item < min){
            underTPercent[ptsIndex] += oneHrToPercent;
            cda[ptsIndex] += oneHrToPercent * item / min;
          }
            //aboveTPercent
          else if(item > max)
          {
            aboveTPercent[ptsIndex] += oneHrToPercent;
          }
            //withinTPercent
          else
          {
            withinTPercent[ptsIndex] += oneHrToPercent;
            cda[ptsIndex] += oneHrToPercent;
          }
        }

      }else{
        //underTPercent[hr] = pos;
      }
    }

    //processedData for one ill file
    List < List < double >> processedData = new List<List<double>>(){};

    processedData.Add(underTPercent);
    processedData.Add(withinTPercent);
    processedData.Add(aboveTPercent);
    processedData.Add(cda);

    return processedData;


  }
# ---------- end readannualresultsiii_2 ----------
reload_analysisgrid_2 = GhPythonScript(pts_file="C:\Users\mm1013\simulation\points.pts", ill_file=panel_137, run=Toggle(True))  # -> out, analysisGrid; inputs hoys: list; disabled
# ---------- reload_analysisgrid_2: Python ----------
"""
    Args:
        _pts_file: Path to a points (*.pts) file
        _ill_file: Path to an illuminance (*.ill) file
        _hoys: A list of hours of the year. This should be the same list as the
            one used to run the simulation earlier.
            
            If you ran an Annual Simulation (using the Annual Daylight, Annual
            Radiation, DC-Grid Based, 3P or 5P recipe), you should provide a
            list of integers from 0 to 8759. If you used smaller timesteps in
            your simulation (e.g. using 'hoys_' input in HoneybeePlus_SkyMatrix
            component), make sure you provide a list with appropriate matching
            timesteps.
            
            If you ran a Solar Access simulation, you could use the hoys output
            from LadybugPlus_SunPath component i.e. the same you provided for the
            Solar Access Recipe.
            
            If you ran a simulation using HoneybeePlus Grid Based Recipe, you
            should enter the same hoy as was used to create the sky.
            
            You can get this _hoys list from:
            (1) LadybugPlus_SunPath component
            (2) LadybugPlus_Analysis Period component
            (3) LadybugPlus_Calculate HOY component
            (4) Standard grasshopper components
        _gridMode_: 0 > load the values. (Default)
            1 > load values as binary. Any non-zero value will be 1. Useful for studies such as Solar Access a.k.a. Sunlight Hours.
            2 > load the values divided by mode number. Use this mode for daylight factor or radiation analysis
        _run: Set to True to load the AnalysisGrid
    Returns:
        analysisGrid: Outputs a analysis grid loaded with results. Connect this
             grid to standard honeybee[+] copmonents to get the values
"""

import rhinoscriptsyntax as rs
from honeybee_radiance.sensorgrid import SensorGrid
#from honeybee.radiance.analysisgrid import AnalysisGrid

if _run == True:


    if _gridMode_ == None:
        gmode = 0
    else:
        gmode = int(_gridMode_)

# first let's create an analysis grid from pts file
    analysisGrid = SensorGrid.from_file(_pts_file)
    

# now let's load the results
    #analysisGrid.set_values_from_file(_ill_file, hoys=_hoys, mode=gmode)
# ---------- end reload_analysisgrid_2 ----------
readannualresultsii = Honeybee_ReadAnnualResultII(resultFilesAddress=panel_137, testPts=long_2.ListA, timeStep=1, runIt=download.Run)  # -> readMe, lessThanRange, inTheRange, moreThanRange; disabled; plug-in component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
python_4 = GhPythonScript(x=reload_analysisgrid_2.analysisGrid)  # -> out, a
# ---------- python_4: Python ----------
__author__ = "mm1013"
__version__ = "2022.05.02"

import rhinoscriptsyntax as rs

a = x.sensors
# ---------- end python_4 ----------
gradient_2 = Gradient(
    LowerLimit="1",
    UpperLimit="0",
    Parameter=annualresults_2.Results,
    stops=[0: RGB(234, 38, 0), 0.25: RGB(234, 126, 0), 0.5: RGB(254, 244, 84), 0.75: RGB(173, 203, 249), 1: RGB(75, 107, 169)])
bnd_2 = Bounds(Numbers=readannualresultsii.inTheRange)
preview_4 = CustomPreview(Geometry=pt_2, Material=gradient_2)

# ==== cluster Cluster
L = ClusterInput()
item = ListItem(List=flatten(L), Index=0, Wrap=True)
rec = DataRecorder(item, DataLimit=-10, RecordData=True)
lng = ListLength(List=rec)
L_2 = ClusterOutput(lng)

# ==== cluster Normals
amplitude = ClusterInput()
amplitude_2 = Data(amplitude)
geo = ClusterInput()
merge = Merge(Data1=flatten(amplitude_2), Data2=flatten("1m"))
geo_2 = Geometry(geo)
item = ListItem(List=merge, Index=0, Wrap=True)
facen = FaceNormals(Mesh=geo_2)  # -> Centers, Normals
U = Units(ValueString=item)
avr = Average(Input=facen.Centers)
avr_2 = Average(Input=facen.Normals)
unflatten = UnflattenTree(Tree=avr, Guide=geo_2)
unflatten_2 = UnflattenTree(Tree=avr_2, Guide=geo_2)
amp = Amplitude(Vector=unflatten_2, Amplitude=U)
pl = PlaneNormal(Origin=unflatten, ZAxis=unflatten_2)
norm = Vector(amp)
center = Point(unflatten)
P = ClusterOutput(pl)
norm_2 = ClusterOutput(norm)
center_2 = ClusterOutput(center)

# ==== cluster DefaultMSS
default_value_flattened = ClusterInput()
data = ClusterInput()
data_2 = Data(data)
merge = Merge(Data1=flatten(data_2), Data2="0")  # -> flatten(Result)
default_value_flattened_2 = Data(flatten(default_value_flattened))
lng = ListLength(List=merge)
equals = Equality(FirstNumber=lng, SecondNumber="1")  # -> Equality, Inequality
cull = CullPattern(List=data_2, CullPattern=invert(equals.Equality))
panel = Panel(equals.Equality)
cull_2 = CullPattern(List=default_value_flattened_2, CullPattern=equals.Equality)
data_3 = Data([cull, cull_2])
data_4 = ClusterOutput(data_3)
